vi "main.gviweb"   [LabVIEW NXG 4.0.0]
panel controls:
  "error in": error
  "Power Button": bool
panel indicators:
  "Card_1": T1
  "Card_2": T1
  "Card_3": T1
  "Card_4": T1
  "Card_5": T1
  "Card_6": T1
  "Card_7": T1
  "Card_8": T1
  "dockBar": string
  "URL Image": string
  "freeNum": string
  "URL Image_2": string
  "busyNum": string
  "URL Image_3": string
  "awayNum": string
  "URL Image_4": string
  "Talks": string
  "errror out": error
  "Time": string
  "Date": string
types:
  T1 = cluster{"AE-Photo": string, "Radial Progress Bar": f64, "CurrentStatePeriod": string, "FullName": string, "ColorCircle": string, "CardBackground": string}
uses:
  SubVIs::DateAndTime.gvi
  SubVIs::createBasicTag.gvi
  SubVIs::readBasicTag.gvi
diagram:
  w1 = $"error in"
  while {
    call "DateAndTime.gvi"(Error In=w1) -> (Date=w2, Time=w3, Error Out=w4)
    $Date <- w2
    $Time <- w3
    Wait(time to wait=1000)
    stop if $"Power Button"
  }
  while {
    call "createBasicTag.gvi"(server url="http://sh-ae-board", username="admin", password="Dashboard", error in=w1) -> (tags=w5, error out=w6)
    call "readBasicTag.gvi"(tags in=w5, error in=w6) -> (Output=w7, errror out=w8)
    Array To Cluster[NumberOfClusterElements=6](array=w7) -> (cluster=w9)
    Property Node(instance in=w9) -> ("Element 1"=w10, "Element 2"=w11, "Element 3"=w12, "Element 4"=w13)
    $freeNum <- w10
    $busyNum <- w11
    $awayNum <- w12
    $Talks <- w13
    stop if $"Power Button"
  }
  Merge Errors(w8, w4) -> (error out=w14)
  $"errror out" <- w14
  Build Cluster("Photos/Sha%20Wang.jpg", 33, "09:55", "Yi Xu", "Resources/greenCircle.png", "Resources/CardBG.png") -> w15
  $Card_1 <- w15
  $Card_2 <- w15
  $Card_3 <- w15
  $Card_4 <- w15
  $Card_5 <- w15
  $Card_6 <- w15
  $Card_7 <- w15
  $Card_8 <- w15
