vi "createCardTag.gvi"   [LabVIEW NXG 4.0.0]
panel controls:
  "password": string
  "username": string
  "server url": string
  "error in": error
panel indicators:
  "error out": error
  "tags": "Tag.gtype"[]
types:
  "DataType.gtype" = enum{"Double", "I32", "String", "Boolean", "U64", "Timestamp"}
  "Client Handle.gtype" = u32
  "Configuration.gtype" = cluster{"Server URL": string, "Session": "Client Handle.gtype"}
  "Tag.gtype" = cluster{"Path": string, "Datatype": "DataType.gtype", "Configuration": "Configuration.gtype"}
uses:
  NI::Skyline::Configuration::Open Configuration.gvi
  NI::Skyline::TagHTTP::Open Tag.gvi
diagram:
  call "Open Configuration.gvi"(server url=$"server url", username=$username, password=$password, error in=$"error in") -> (configuration=w1, error out=w2)
  Build Array("String", "String", "String", "String", "String", "String") -> w3
  for {
    w4 = each element of w3
    call "Open Tag.gvi"(path=w6, data type=w4, error in=w2, configuration=w1) -> (tag=w7, error out=w8)
    append w7 to w5
    stop if w8
  }
  $tags <- w5
  $"error out" <- w8
